# Grasshopper definition CurveDomainIssueInPython.gh (Grasshopper 0.8.66)

crv = Curve([<curve referenced from the Rhino model> x7])
python = PythonScript(crvs=crv)  # -> midPts; inputs crvs: list of Curve
# ---------- python: Python ----------
import Rhino as rc

midPts = []
for c in crvs:
    print type(c) #Problem with PolyCurve type maybe?
    print c.Domain # The domain seem ok i.e (0,1)
    c.Domain = rc.Geometry.Interval(0,1)
    midPoint = c.PointAt(0.5)
    midPts.append(midPoint)
# ---------- end python ----------
curvepoint = PointOnCurve(crv, parameter=0.5)
preview = CustomPreview(Geometry=python, Shader=ColourSwatch(SwatchColor=RGB(255, 0, 0)))
preview_2 = CustomPreview(Geometry=curvepoint, Shader=ColourSwatch(SwatchColor=RGB(0, 255, 0)))

# ---- group: Raw Medial Axis Graph
crv_2 = Curve([<curve referenced from the Rhino model> x46])

# ----
merge_search_value = Slider(48, range=0..100)

# ---- group: Merge Nodes (Cull Small Branches and Modify Remaining Branches) / Input Curves
crv_3 = Curve(reparameterize(crv_2))

# ----
smooth_strength = Slider(1, range=0..1)
smooth_iterations = Slider(10, range=1..10)
rebuild_resolution_cm = Slider(40, range=1..100)
graph_output = ValueList({"Topological Distance Graph": 0, "Euclidian Distance Graph": 1, "None": 2}, selected=[], ListIndex=1, UIMode=1)

# ---- group: Merge Nodes (Cull Small Branches and Modify Remaining Branches)
len = Length(Curve=crv_3)
smaller = SmallerThan(FirstNumber=len, SecondNumber=merge_search_value)  # -> SmallerThan, OrEqualTo
dispatch = Dispatch(List=crv_3, DispatchPattern=invert(smaller.SmallerThan))  # -> ListA, ListB
cp = ControlPoints(Curve=reparameterize(graft(dispatch.ListA)))  # -> simplify(Points), Weights, Knots
join = JoinCurves(Curves=dispatch.ListB, Preserve=False)  # -> reparameterize(flatten(Curves))
lng = ListLength(List=dispatch.ListB)
lng_2 = ListLength(List=crv_3)
division = Division(A=lng, B=lng_2)
multiplication = Multiplication(A=division, B=100)
curvepoint_2 = PointOnCurve(join, parameter=0.5)

# ---- group: Move similar points to same position
pt = Point(flatten(curvepoint_2))
exdiff = SetDifferenceS(SetA=pt, SetB=graft(pt))  # -> simplify(ExDifference)
fsim = FindSimilarMember(Data=pt, Set=exdiff)  # -> Hit, Index
vec2pt = Vector2Pt(PointA=pt, PointB=fsim.Hit, Unitize=False)  # -> Vector, Length
equals = Equality(FirstNumber=vec2pt.Length, SecondNumber=0)  # -> Equality, Inequality
cull = CullPattern(List=vec2pt.Vector, CullPattern=invert(equals.Equality))  # -> simplify(flatten(List))
vlen = VectorLength(Vector=cull)
num = Number(merge_search_value)
smaller_2 = SmallerThan(FirstNumber=vlen, SecondNumber=num)  # -> SmallerThan, OrEqualTo
mindex = MemberIndex(Set=smaller_2.OrEqualTo, Member=False)  # -> Index, Count
vec = Vector(Vector(0, 0, 0))
replace = ListReplace(List=cull, Item=vec, Indices=mindex.Index, Wrap=False)
move = Move(Geometry=pt, Motion=expr("T*0.5", replace))  # -> flatten(Geometry), Transform

# ---- group: Branches Culled (%)
panel = Panel(multiplication)

# ---- group: Merge Nodes (Cull Small Branches and Modify Remaining Branches) (continued)
cp_2 = ClosestPoint(Point=cp.Points, Cloud=move.Geometry)  # -> ClosestPoint, CPIndex, Distance
smaller_3 = SmallerThan(FirstNumber=cp_2.Distance, SecondNumber=merge_search_value)  # -> SmallerThan, OrEqualTo

# ---- group: Merge Nodes (Cull Small Branches and Modify Remaining Branches) / Filter out non endpoints
lng_3 = ListLength(List=smaller_3.OrEqualTo)
dom = Domain(DomainStart=0, DomainEnd=expr("b-1", lng_3))
repeat = RepeatData(Data=False, Length=lng_3)
range = Range(Domain=dom, Steps=1)
replace_2 = ListReplace(List=repeat, Item=True, Indices=range, Wrap=False)  # -> simplify(List)

# ---- group: Merge Nodes (Cull Small Branches and Modify Remaining Branches) (continued)
and = GateAnd(A=smaller_3.OrEqualTo, B=replace_2)
mindex_2 = MemberIndex(Set=and, Member=True)  # -> Index, Count
item = ListItem(List=cp_2.ClosestPoint, Index=mindex_2.Index, Wrap=False)
replace_3 = ListReplace(List=cp.Points, Item=item, Indices=mindex_2.Index, Wrap=False)  # -> simplify(List)
pline = PolyLine(Vertices=replace_3, Closed=False)  # -> simplify(flatten(Polyline))
smoothpline = SmoothPolyline(Polyline=pline, Strength=smooth_strength, Times=smooth_iterations)

# ---- group: Join Curves and Split at Graph Nodes (Valence >= 3)
crv_4 = Curve(smoothpline)
join_2 = JoinCurves(Curves=crv_4, Preserve=False)  # -> reparameterize(Curves)
cx = CurveSelf(Curve=graft(join_2))  # -> Points, Params
shatter = Shatter(Curve=graft(join_2), Parameters=cx.Params)  # -> reparameterize(flatten(Segments))
path_mapper = PathMapper(shatter, source="{a}", target="{0;0;a}")

# ---- group: Join Curves and Split at Graph Nodes (Valence >= 3) / Find Graph Nodes with Valence >= 3
end = EndPoints(Curve=crv_4)  # -> Start, End
pt_2 = Point([end.Start, end.End])
cset = CreateSet(List=pt_2)  # -> Set, Map
mindex_3 = MemberIndex(Set=pt_2, Member=cset.Set)  # -> Index, Count
larger = LargerThan(FirstNumber=mindex_3.Count, SecondNumber=3)  # -> LargerThan, OrEqualTo
cull_2 = CullPattern(List=cset.Set, CullPattern=larger.OrEqualTo)

# ---- group: Join Curves and Split at Graph Nodes (Valence >= 3) (continued)
crv_cp = CurveCP(Point=cull_2, Curve=graft(path_mapper))  # -> Point, Parameter, Distance
equals_2 = Equality(FirstNumber=expr("Floor(A)", crv_cp.Distance), SecondNumber=0)  # -> Equality, Inequality
cull_3 = CullPattern(List=crv_cp.Parameter, CullPattern=equals_2.Equality)  # -> simplify(List)
shatter_2 = Shatter(Curve=graft(path_mapper), Parameters=cull_3)  # -> reparameterize(flatten(Segments))

# ---- group: Cull Leaf Branches
crv_5 = Curve(reparameterize(shatter_2))

# ---- group: Cull Leaf Branches / Find Graph End Points
end_2 = EndPoints(Curve=crv_5)  # -> Start, End
pt_3 = Point([end_2.Start, end_2.End])
cset_2 = CreateSet(List=pt_3)  # -> Set, Map
mindex_4 = MemberIndex(Set=pt_3, Member=cset_2.Set)  # -> Index, Count
equals_3 = Equality(FirstNumber=mindex_4.Count, SecondNumber=1)  # -> Equality, Inequality
cull_4 = CullPattern(List=cset_2.Set, CullPattern=equals_3.Equality)  # -> flatten(List)

# ---- group: Cull Leaf Branches / Check if Graph Endpoints == Curve Endpoints
end_3 = EndPoints(Curve=crv_5)  # -> Start, End
equals_4 = Equality(FirstNumber=graft(end_3.Start), SecondNumber=cull_4)  # -> Equality, Inequality
equals_5 = Equality(FirstNumber=graft(end_3.End), SecondNumber=cull_4)  # -> Equality, Inequality
or = GateOr(A=equals_4.Equality, B=equals_5.Equality)
ma = MassAddition(Input=or)  # -> flatten(Result), PartialResults
f_x = F1(Function="If(x>0, true, false)", X=ma.Result)

# ---- group: Cull Leaf Branches (continued)
dispatch_2 = Dispatch(List=crv_5, DispatchPattern=invert(f_x))  # -> ListA, ListB

# ---- group: Join Curves and Split at Graph Nodes (Valence >= 3)
crv_6 = Curve(dispatch_2.ListA)
join_3 = JoinCurves(Curves=crv_6, Preserve=False)  # -> reparameterize(Curves)
cx_2 = CurveSelf(Curve=graft(join_3))  # -> Points, Params
shatter_3 = Shatter(Curve=graft(join_3), Parameters=cx_2.Params)  # -> reparameterize(flatten(Segments))
path_mapper_2 = PathMapper(shatter_3, source="{a}", target="{0;0;a}")

# ---- group: Join Curves and Split at Graph Nodes (Valence >= 3) / Find Graph Nodes with Valence >= 3
end_4 = EndPoints(Curve=crv_6)  # -> Start, End
pt_4 = Point([end_4.Start, end_4.End])
cset_3 = CreateSet(List=pt_4)  # -> Set, Map
mindex_5 = MemberIndex(Set=pt_4, Member=cset_3.Set)  # -> Index, Count
larger_2 = LargerThan(FirstNumber=mindex_5.Count, SecondNumber=3)  # -> LargerThan, OrEqualTo
cull_5 = CullPattern(List=cset_3.Set, CullPattern=larger_2.OrEqualTo)

# ---- group: Join Curves and Split at Graph Nodes (Valence >= 3) (continued)
crv_cp_2 = CurveCP(Point=cull_5, Curve=graft(path_mapper_2))  # -> Point, Parameter, Distance
equals_6 = Equality(FirstNumber=expr("Floor(A)", crv_cp_2.Distance), SecondNumber=0)  # -> Equality, Inequality
cull_6 = CullPattern(List=crv_cp_2.Parameter, CullPattern=equals_6.Equality)  # -> simplify(List)
shatter_4 = Shatter(Curve=graft(path_mapper_2), Parameters=cull_6)  # -> reparameterize(flatten(Segments))
clean = CleanTree(Data=shatter_4, CleanInvalid=True, CleanEmpty=False)  # -> flatten(Data)

# ---- group: Rebuild Medial Axis Curves
crv_7 = Curve(clean)
len_2 = Length(Curve=crv_7)
division_2 = Division(A=len_2, B=rebuild_resolution_cm)
end_5 = EndPoints(Curve=crv_7)  # -> Start, End
reb = Rebuild(Curve=crv_7, Degree=1, Count=expr("Ceiling(N)", division_2), Tangents=False)
ln = Line(StartPoint=end_5.Start, EndPoint=end_5.End)
cp_3 = ControlPoints(Curve=reb)  # -> Points, Weights, Knots
pline_2 = PolyLine(Vertices=cp_3.Points, Closed=False)
circle = CircleCNR(Center=cp_3.Points, Normal=Vector(0, 0, 1), Radius=expr("R/2", rebuild_resolution_cm))

# ---- group: Rebuild Medial Axis Curves / Euclidean Distance Graph
crv_8 = Curve(reparameterize(flatten(pline_2)))

# ---- group: Rebuild Medial Axis Curves / Topological Distance Graph
line = Line(flatten(ln))

# ---- group: Rebuild Medial Axis Curves / Graph for Analysis
filter = StreamFilter(Gate=graph_output, Stream0=line, Stream1=crv_8)  # -> simplify(flatten(Stream))

# ---- group: Reconstructed Medial Axis Graph
crv_9 = Curve(filter)
