# Grasshopper definition HEM.gh (Grasshopper 1.0.7)

# DESIGN.EPFL.CH/ORGANICITES
# CODE QUOTIDIEN: Definition originally written for
#   Organicités: Growth Typologies
#   Media × Design Lab: EPFL
#   [Laboratoire de Design et Media]
# 
#              codeQuotidien.wordpress.org
#              Trevor Patt
#              trpatt@gmail.com
# 
#   Creative Commons:
#     Attribution
#     NonCommercial
#     ShareAlike
# 0219-2013
crv = Curve([<curve referenced from the Rhino model> x10])
explode = Explode(Curve=crv, Recursive=True)  # -> reparameterize(flatten(Segments)), Vertices

# ----
# ATTENTION: Be sure there are no duplicate segments!
crv_2 = Curve(explode.Segments)
x_bounds = Domain(Domain(1950, 3650))
y_bounds = Domain(Domain(2750, 3550))
grid_divisions = Integer(20)

dom² = Domain²(DomainU=x_bounds, DomainV=y_bounds)

# ---- group: PREVIEW SUBDIV GRID
divide = DivideDomain²(Domain=dom², UCount=grid_divisions, VCount=grid_divisions)
dom = Domain²Components(Domain=divide)  # -> UComponent, VComponent
rectangle = Rectangle(Plane=PlaneXY(0, 0, 0), XSize=dom.UComponent, YSize=dom.VComponent, Radius=0)  # -> Rectangle, Length
preview = CustomPreview(Geometry=rectangle.Rectangle, Shader=ColourSwatch(SwatchColor=RGB(217, 217, 217)))

# ----
hem_open_xy_networks = VBScript(seg=crv_2, bnd=dom², sbdv=grid_divisions)  # -> out, flatten(e), flatten(eOV), flatten(ePE), flatten(eNE), flatten(eTE), flatten(eIF), flatten(v)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; inputs seg: list of Curve
# ---------- hem_open_xy_networks: VB usings ----------
Imports System.IO
Imports System.Linq
Imports System.Data
Imports System.Drawing
Imports System.Reflection
Imports System.Windows.Forms
Imports System.Xml
Imports System.Xml.Linq
Imports Microsoft.VisualBasic
Imports System.Runtime.InteropServices

Imports Rhino.DocObjects
Imports Rhino.Collections
Imports GH_IO
Imports GH_IO.Serialization
# ---------- hem_open_xy_networks: VB ----------
    Dim edgeList As New list(Of Line)
    Dim eOVlist As New dataTree(Of int32)
    Dim ePElist As New dataTree(Of int32)
    Dim eNElist As New dataTree(Of int32)
    Dim eTElist As New list(Of int32)
    Dim eIFlist As New list(Of int32)
    Dim vtxList As New list(Of point3d)
    Dim vIElist As New list(Of int32)
    Dim fList As New datatree(Of point3d)
    Dim fIElist As New dataTree(Of int32)

    Dim vIEall As New dataTree(Of int32)
    Dim eF As New list(Of Boolean)

    Dim eDegList As New List(Of Double)

    '********FOR EACH SEGMENT, ADD EDGE AND ITS REVERSE (twin) TO edgeList********
    Dim segCt As int32 = 0
    For i As int32=0 To seg.count - 1
      If seg(i).pointAtStart.distanceto(seg(i).pointAtEnd) > 0 Then
        edgeList.add(New Line(seg(i).pointAtStart, seg(i).pointAtEnd))
        edgeList.add(New Line(seg(i).pointAtEnd, seg(i).pointAtStart))
        eTEList.add((segCt * 2) + 1)
        eTEList.add((segCt * 2))
        'DEFAULT SETTING FOR ef IS TRUE (ie EDGE NEEDS TO BE ASSIGNED TO A FACE)
        ef.add(True)
        ef.add(True)
        eIFlist.add(-10)
        eIFlist.add(-10)

        EdgeDirection(edgeList(edgeList.count - 2), eDegList)
        segCt += 1
      End If
    Next

    Dim vtxTree As New dataTree(Of point3d)
    Dim vNdxTree As New dataTree(Of Int32)
    For i As int32=0 To sbdv - 1
      For j As int32=0 To sbdv - 1
        vtxTree.ensurepath(New gh_path(i, j))
        vNdxTree.ensurepath(New gh_path(i, j))
      Next
    Next


    '********CONSTRUCT VERTEX LIST FROM LIST OF HALF-EDGES********
    For i As int32=0 To edgeList.count - 1
      'boolCk = (is there a close point?, what is the index)
      Dim boolCk() As int32 = {0,-10}

      Dim vCt As int32 = vtxTree.datacount
      CheckLinePt(edgeList(i), vtxTree, vNdxTree, boolCk, bnd, sbdv, 0)

      'IF A NEW VERTEX WAS ADDED, THEN ADD EDGE INDEX TO vIE, vIEall, AND eOV
      If vtxTree.datacount > vCt Then
        vIElist.add(i)
        vIEall.add(i, New GH_Path(boolCk(1)))
        eOVlist.add(boolCk(1), New GH_Path(i))

      Else If boolCK(1) >= 0 Then
        vIEall.add(i, New GH_Path(boolCK(1)))
        eOVlist.add(boolCK(1), New GH_Path(i))
      End If
    Next



    '********FROM EACH HALF-EDGE..
    For i As int32=0 To edgeList.count - 1
      Dim boolCk() As int32 = {0,-10}
      'FIND VERTEX CORRESPONDING TO ENDPOINT (=boolCk(1))
      CheckLinePt(edgeList(i), vtxTree, vNdxTree, boolCk, bnd, sbdv, 1)

      'boolCk(1)=TARGET VERTEX, CHECK ANGLE OF ALL EDGES LEAVING THIS VERTEX
      Dim nxtVtxPth As New gh_path(boolCk(1))
      Dim angCk As Double = -100
      Dim ndx As int32 = -10
      'Dim xProd As vector3d = vector3d.CrossProduct(edgeList(i).direction, vector3d.ZAxis)

      testtt = vIEall

      '..FIND NEXT EDGE********
      For j As int32=0 To vIEall.branch(nxtVtxPth).count - 1
        If i <> eTElist(vIEall(nxtVtxPth, j)) Then
          Dim ang As Double = eDegList(eTElist(i)) - eDegList(vIEall(nxtVtxPth, j))
          If ang < 0 Then ang += 360
          If ang > angCk  Then
            angCk = ang
            ndx = j
          End If
        End If
      Next

      If ndx >= 0 Then
        eNElist.add(vIEall(nxtVtxPth, ndx), New GH_Path(i))
        ePElist.add(i, New GH_Path(vIEall(nxtVtxPth, ndx)))
      Else
        'NO NEXT EDGE FOUND, THEN NEXT EDGE IS TWIN
        angCk = math.PI
        ndx = eTElist(i)
        eNElist.add(eTElist(i), New GH_Path(i))
        ePElist.add(i, New GH_Path(eTElist(i)))
      End If
    Next



    '********FIND EDGE-LOOPS / 'FACES'********
    Dim faceCt As int32 = 0
    For i As int32=0 To edgeList.count - 1
      If ef(i) Then
        fList.add(edgeList(i).pointAt(0), New gh_path(faceCt))
        fIEList.add(i, New gh_path(faceCt))
        eIFlist(i) = faceCt
        ef(i) = False
        loopFace(edgeList, ef, eNElist, eNElist(New GH_Path(i), 0), i, fIElist, fList, eIFlist, faceCt)
        faceCt += 1
      End If
    Next


    '********CONVERT vtxTree (SORTED IN BRANCHES BY LOCATION IN GRID)TO LIST (IN ORDER OF INDEX VALUE)********
    For i As int32=0 To vtxTree.datacount - 1
      vtxList.add(Nothing)
    Next
    For i As int32=0 To vtxTree.datacount - 1
      Dim sortNdx As int32 = vNdxTree.alldata(i)
      vtxList(sortNdx) = vtxTree.alldata(i)
    Next

    e = edgeList
    eOV = eOVlist
    eNE = eNElist
    ePE = ePElist
    eTE = eTElist
    eIF = eIFlist
    v = vtxList ' vtxTree
    vIE = vIEall
    f = fList
    fIE = fIElist

    '********PRINT HEM STATS********
    print(vtxList.count & " vertices")
    print(faceCt & " faces")
    print(edgeList.count & " ½ edges")
# ---------- hem_open_xy_networks: VB additional code ----------
  Sub CheckLinePt(ByVal eCurr As Line, ByRef vTree As datatree(Of point3d), ByRef nTree As datatree (Of int32), ByRef ck As Array, ByVal dom As UVInterval, ByVal div As int32, ByVal t As Double)
    'WHEN t=0: CHECKING START POINT; WHEN t=1: CHECKING END POINT
    Dim ptCk As New point3d(eCurr.PointAt(t))

    'POINT VALUE (MINUS DOMAIN STARTING POINT) DIVIDED BY STEP, FLOORED
    Dim pthX As int32 = Math.floor((ptCk.X - dom.u0) / ((dom.U1 - dom.U0) / div))
    Dim pthY As int32 = Math.floor((ptCk.y - dom.v0) / ((dom.v1 - dom.v0) / div))
    pthX = math.min(math.Max(pthX, 0), div - 1)
    pthY = math.min(math.Max(pthY, 0), div - 1)
    Dim pthXY As New gh_path(pthX, pthY)
    ck(1) = -10

    'CHECK ALREADY ADDED NODES
    If vTree.pathExists(pthXY) Then
      For j As int32=0 To vTree.branch(pthXY).count - 1
        If ptCk.DistanceTo(vTree(pthXY, j)) < .1 Then
          ck(0) += 1
          ck(1) = nTree(pthXY, j)
          Exit For
        End If
      Next
    End If

    'IF NOT ALREADY ADDED, THEN ADD
    If  ck(0) = 0 AndAlso ck(1) < 0 Then
      ck(1) = vTree.datacount
      nTree.add(vTree.datacount, pthXY)
      vTree.add(ptCk, pthXY)
    End If

  End Sub


  Sub EdgeDirection(ByRef eCurr As Line, ByRef degList As List(Of Double))
    'FIND DIRECTION OF EDGE
    Dim deg As Double
    If eCurr.direction.x = 0 Then
      deg = (90 * (eCurr.Direction.Y / math.abs(eCurr.Direction.Y))) + 360
      deg = (360 + deg) Mod 360
    Else
      deg = ((math.atan(eCurr.Direction.Y / eCurr.Direction.x)) * 180 / math.PI)
      If eCurr.Direction.X < 0 Then deg = 180 + deg
      If eCurr.Direction.X > 0  Then deg = (360 + deg) Mod 360
    End If

    degList.add(deg)
    degList.add((deg + 180) Mod 360)
  End Sub


  Sub loopFace(ByVal eList As list(Of line), ByRef ck As list(Of Boolean), ByVal eNE As datatree(Of int32), ByVal n As int32, ByVal init As int32, ByRef fList As datatree(Of int32), ByRef f As datatree(Of point3d), ByRef efList As List(Of int32), ByRef ct As int32)
    If n <> init Then
      f.add(eList(n).pointAt(0), New gh_path(ct))
      fList.add(n, New gh_path(ct))
      efList(n) = ct
      ck(n) = False
      loopFace(eList, ck, eNE, eNE(New GH_Path(n), 0), init, fList, f, efList, ct)
    End If
  End Sub
# ---------- end hem_open_xy_networks ----------
details = Panel(hem_open_xy_networks.out)
python = GhPythonScript(seg=explode.Segments, bnd=dom², sbdv=grid_divisions)  # -> out, edgeList, eTEList, eF, eIFList, segCt, eDegList, vtxTree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; inputs seg: list of Curve, sbdv: Int32
# ---------- python: Python ----------
__author__ = "User"
__version__ = "2022.04.05"

import rhinoscriptsyntax as rs
import math
import Rhino
import ghpythonlib.treehelpers as th
import System.Array as array
from Grasshopper import DataTree
from Grasshopper.Kernel.Data import GH_Path


def EdgeDirection(crv,eDegList):
    if crv.Direction.X==0:
        deg=(90*(crv.Direction.Y/math.abs(crv.Direction.Y))+360)
        
    
    else:
        deg=((math.atan(crv.Direction.Y/crv.Direction.X))*180/math.pi)
        if crv.Direction.X<0:
            deg=180+deg
        
        if crv.Direction.X>0:
            deg=(360+deg) % 360 
     
    eDegList.append(deg)
    eDegList.append((deg+180)%360)
         


def CheckLinePt(eCurr,vTree,nTree,ck,dom,div,t):
    #When t=0: checking start point; when t=1:checking end point
    if t==0:
        ptCk=rs.coercecurve(eCurr).PointAtStart
    
    if t==1:
        ptCk=rs.coercecurve(eCurr).PointAtEnd

    #Point value  (minus domain starting point) divided by step, floored   #??????
    pthX=math.floor((ptCk.X-dom.U0)/((dom.U1-dom.U0)/div))
    pthY=math.floor((ptCk.Y-dom.V0)/((dom.V1-dom.V0)/div))
    pthX=min(max(pthX,0),div-1)
    pthY=min(max(pthY,0),div-1)
    pthXY=GH_Path(pthX,pthY)
    ck[1]=-10
    
    
    #Check already added nodes
    if vTree.PathExists(pthXY):
        for j in range(vTree.Branch(pthXY).Count):
            
            if ptCk.DistanceTo(vTree[pthXY,j])<0.00001:
                ck[0] += 1
                ck[1] = nTree[pthXY,j]
    
    #If not already added, then add
    
    if ck[0]==0 and ck[1]<0:
        
        ck[1]=vTree.DataCount
        nTree.Add(vTree.DataCount,pthXY)
        vTree.Add(ptCk,pthXY)
    
    

    
def LoopFace(eList,ck,eNE,n,init,fList,f,efList,ct):
    if n!=init:
        f.Add(rs.coercegeometry(eList[n]).PointAtStart,GH_Path(ct))
        fList.Add(n,GH_Path(ct))
        efList[n]=ct
        ck[n]=False
        LoopFace(eList,ck,eNE,eNE[GH_Path(n),0],init,fList,f,efList,ct)

edgeList=[]  #store edges
eOVList= DataTree[object]() 
ePEList= DataTree[object]()
eNEList= DataTree[object]()

eTEList=[]  #store edges index 
eIFList=[]  #not sure
vtxList=[]
vIEList=[]
fList=DataTree[object]()
fIEList=DataTree[int]()

vIEall=DataTree[int]()  #all the edges connected one point
eF=[]  #default setting for ef is True (ie edge needs to be assigned to a face)

eDegList=[] #line degree

#For each segment,add edge and its reverse(twin) to edgeList
segCt=0

for i in range(seg.Count):
    if seg[i].PointAtStart.DistanceTo(seg[i].PointAtEnd)>0:
        edgeList.append(rs.AddLine(seg[i].PointAtStart,seg[i].PointAtEnd))
        edgeList.append(rs.AddLine(seg[i].PointAtEnd,seg[i].PointAtStart))
        eTEList.append((segCt*2)+1)
        eTEList.append((segCt*2))
        
        #default setting for ef is True (ie edge needs to be assigned to a face)
        eF.append(True)
        eF.append(True)
        eIFList.append(-10)
        eIFList.append(-10)
        
        EdgeDirection(rs.coerceline(edgeList[edgeList.Count-2]),eDegList)
        segCt+=1




vtxTree= DataTree[object]()
vNdxTree = DataTree[object]()



for i in range(0,sbdv):
    for j in range(0,sbdv):
        vtxTree.EnsurePath(GH_Path(i,j))
        vNdxTree.EnsurePath(GH_Path(i,j))


#construct vertex list from list of halfedges
for i in range(0,edgeList.Count):
    #boolCk = [is there a close point?, what is the index]
    boolCk=[0,-10]
    vCt=vtxTree.DataCount
    
    CheckLinePt(edgeList[i],vtxTree,vNdxTree,boolCk,bnd,sbdv,0)

   
    #if a new vertex was added,then add edge index to vIE, vIEall, AND eOV
    if vtxTree.DataCount>vCt:
        vIEList.Add(i)
        vIEall.Add(i,GH_Path(boolCk[1]))
        eOVList.Add(boolCk[1],GH_Path(i))
        
    elif boolCk[1]>=0:
        vIEall.Add(i,GH_Path(boolCk[1]))
        eOVList.Add(boolCk[1],GH_Path(i))


#from each half-edge...

for i in range(0,edgeList.Count):
    boolCk=[0,-10]
    
    #find vertex corresponding to endpoint (=boolCk[1])
    CheckLinePt(edgeList[i],vtxTree,vNdxTree,boolCk,bnd,sbdv,1)
    
    #boolCk[1]=Target vertex,check angle of all edges leaving this vertex
    nxtVtxPth = GH_Path(boolCk[1])

    angCk = -100
    ndx = -10


#xprod=rs.Vector3d.Crossproduect(edgeList[i].Direction, rs.Vector3D.Zaxis)
    
    #find next edge

    for j in range(0,vIEall.Branch(nxtVtxPth).Count):
        if i!=eTEList[vIEall[nxtVtxPth,j]]:
            ang = eDegList[eTEList[i]]-eDegList[vIEall[nxtVtxPth,j]]
            
            if ang<0:
                ang+=360
            
            if ang>angCk:
                angCk = ang
                ndx = j
                
    if ndx>=0:
        eNEList.Add(vIEall[nxtVtxPth,ndx], GH_Path(i))
        ePEList.Add(i,GH_Path(vIEall[nxtVtxPth,ndx]))
    
    else:
        #no next edge found, then next edge is twin
        
        angCk = math.pi
        ndx = eTEList[i]
        eNEList.Add(eTEList[i],GH_Path(i))
        ePEList.Add(i,GH_Path(eTEList[i]))
        
        
#find edge-loops/face
faceCt=0
for i in range(0,edgeList.Count):
    if eF[i]:
        fList.Add(rs.coercegeometry(edgeList[i]).PointAtStart,GH_Path(faceCt))
        fIEList.Add(i,GH_Path(faceCt))
        eIFList[i]=faceCt
        eF[i]=False
        
        
        LoopFace(edgeList,eF,eNEList,eNEList[GH_Path(i),0],i,fIEList,fList,eIFList,faceCt)

#convert vtxTree(sorted in branches by location in grid) to list(in order of index value)

for i in range(0,vtxTree.DataCount):
    vtxList.append(None)

sortNdx=vNdxTree.AllData()
sortvtx=vtxTree.AllData()
for i in range(0,vtxTree.DataCount):
    
    vtxList[sortNdx[i]]=sortvtx[i]
# ---------- end python ----------

# ---- group: FACES AS CLOSED POLYLINES
pline = PolyLine(Vertices=hem_open_xy_networks.f, Closed=True)

# ---- group: DISPLAY HALF-EDGES AS VECTORS
offset = Offset(Curve=hem_open_xy_networks.e, Distance=1.5, Plane=PlaneXY(0, 0, 0), Corners=1)  # -> flatten(Curve); disabled
curvepoint = PointOnCurve(offset, parameter=0.851)  # disabled
curvepoint_2 = PointOnCurve(offset, parameter=0)  # disabled
curvepoint_3 = PointOnCurve(offset, parameter=0.351)  # disabled
vec2pt = Vector2Pt(PointA=curvepoint_2, PointB=curvepoint, Unitize=False)  # -> Vector, Length; disabled
vdis = VectorDisplay(Anchors=curvepoint_2, Vectors=vec2pt.Vector)  # disabled
points = PointList(Points=curvepoint_3, Tags=True, Lines=False, Size=2)  # disabled

# ---- group: SELECT FACE
branch = TreeBranch(Tree=hem_open_xy_networks.fIE, Path=Slider(0, range=0..100), MaintainPaths=True)
item = ListItem(List=hem_open_xy_networks.e, Index=branch, Wrap=False)
planar = PlanarSrf(Edges=item)

# ----
# pointat
number_slider = Slider(0, range=0..100)
crv_3 = Curve(<curve referenced from the Rhino model>)
python_2 = GhPythonScript(x=crv_3, t=number_slider)  # -> out, a; inputs x: Curve, t: Int32
# ---------- python_2: Python ----------
__author__ = "User"
__version__ = "2022.04.10"

import rhinoscriptsyntax as rs

a=x.PointAt(t)
# ---------- end python_2 ----------

# ----
# Domain
x_bounds_2 = Domain(Domain(1950, 3650))
y_bounds_2 = Domain(Domain(2750, 3550))
dom²_2 = Domain²(DomainU=x_bounds_2, DomainV=y_bounds_2)
python_3 = GhPythonScript(dom=dom²_2)  # -> out, U0, U1, V0, V1
# ---------- python_3: Python ----------
__author__ = "User"
__version__ = "2022.04.10"

import rhinoscriptsyntax as rs

U0=dom.U0
# ---------- end python_3 ----------

# ----
# GH_Path
series = Series(Start=0, Step=1, Count=10)
panel = Panel(series)
series_2 = Series(Start=series, Step=1, Count=10)  # -> simplify(Series)
panel_2 = Panel(series_2)
python_4 = GhPythonScript(x=series_2)  # -> out, a; inputs x: tree
# ---------- python_4: Python ----------
__author__ = "User"
__version__ = "2022.04.12"

from Grasshopper.Kernel.Data import GH_Path
from Grasshopper import DataTree
import rhinoscriptsyntax as rs
import System.Array as array

path=GH_Path(0)
a=x[path,0]
# ---------- end python_4 ----------
panel_3 = Panel(python_4.out)
panel_4 = Panel(python_4.a)

# ----
# Array
python_5 = GhPythonScript()  # -> out, a
# ---------- python_5: Python ----------
__author__ = "User"
__version__ = "2022.04.10"

import rhinoscriptsyntax as rs
import System.Array as array

A=array[int]([0,0])
print A
A[1]=-10
print A
# ---------- end python_5 ----------

# ----
# GH_Path
python_6 = GhPythonScript()  # -> out, a, b, path1, layerTree
# ---------- python_6: Python ----------
__author__ = "User"
__version__ = "2022.04.10"

from Grasshopper.Kernel.Data import GH_Path
from Grasshopper import DataTree
import rhinoscriptsyntax as rs
import System.Array as array

b=[0,0,1]
c=[0]
print type(b)
a=array[int]([0,0,1])
print type(a)
path1=GH_Path(a)
path2=GH_Path(3)
layerTree = DataTree[object]()
layerTree.AddRange(c,path2)
# ---------- end python_6 ----------
panel_5 = Panel(python_6.a)
panel_6 = Panel(python_6.b)
panel_7 = Panel(python_6.path1)
panel_8 = Panel(python_6.layerTree)

python_7 = GhPythonScript(x=crv_3, t=number_slider, dom=dom²_2, div=Slider(20, range=0..100))  # -> out, a; inputs x: Curve
# ---------- python_7: Python ----------
__author__ = "User"
__version__ = "2022.04.10"

import rhinoscriptsyntax as rs
import math
from Grasshopper.Kernel.Data import GH_Path
from Grasshopper import DataTree

ptCk=x.PointAt(t)

pthX=math.floor((ptCk.X-dom.U0)/((dom.U1-dom.U0)/div))
pthY=math.floor((ptCk.Y-dom.V0)/((dom.V1-dom.V0)/div))
pthX=min(max(pthX,0),div-1)
pthY=min(max(pthY,0),div-1)
pthXY=GH_Path(pthX,pthY)

a=pthXY
# ---------- end python_7 ----------

# ---- group: SELECT EDGES WITH SAME ORIGIN VERTEX
slider = Slider(0, range=0..200)
branch_2 = TreeBranch(Tree=hem_open_xy_networks.vIE, Path=slider, MaintainPaths=True)
item_2 = ListItem(List=hem_open_xy_networks.e, Index=branch_2, Wrap=False)

# ---- group: SELECT VERTEX
item_3 = ListItem(List=hem_open_xy_networks.v, Index=slider, Wrap=False)
cir = Circle(Plane=item_3, Radius=2)
srf = Surface(cir)

# ---- group: SELECT EDGES WITH SAME ORIGIN VERTEX (continued)
vdis_2 = VectorDisplay(Anchor=item_3, Vector=item_2)
