# Grasshopper definition datatree_examples.gh (Grasshopper 1.0.7)

panel = Panel("""1
2
3""")
panel_2 = Panel("""a
b
c""")
line = Line(Line((0, 0, 0), (10, 10, 0)))
box = Box({Plane=PlaneXY(-17.38781117, -9.785726393, 0), X=Domain(0, 4.482602728), Y=Domain(0, 4.058462887), Z=Domain(0, 6.765692237)})
panel_3 = Panel("""Default
Layer 01""")
graft = GraftTree(Tree=[line, box], IncludeEmptyLists=True, IncludeNullItems=True)
int = Integer(panel)
graft_2 = GraftTree(Tree=panel_2, IncludeEmptyLists=True, IncludeNullItems=True)
graft_3 = GraftTree(Tree=int, IncludeEmptyLists=True, IncludeNullItems=True)
data = Data([graft_2, graft_3, graft])
objsinlayers = GhPythonScript(layernames=panel_3)  # -> out, a; inputs layernames: list of String
# ---------- objsinlayers: Python ----------
import Rhino


# for accesssing GH classes
from Grasshopper.Kernel.Data import GH_Path
from Grasshopper import DataTree
import System.Array as array

layerTree = DataTree[object]() # make a DataTree
for i in range(len(layernames)):
    objs = Rhino.RhinoDoc.ActiveDoc.Objects.FindByLayer(layernames[i])
    
    if objs:
        geoms = [obj.Geometry for obj in objs]
        path = GH_Path(array[int]([0,0,i]))
        layerTree.AddRange(geoms, path)
        
a = layerTree
# ---------- end objsinlayers ----------
objsinlayers_th = GhPythonScript(layernames=panel_3)  # -> out, a; inputs layernames: list of String
# ---------- objsinlayers_th: Python ----------
import ghpythonlib.treehelpers as th
import Rhino

layerTree = []

for i in range(len(layernames)):
    objs = Rhino.RhinoDoc.ActiveDoc.Objects.FindByLayer(layernames[i])
    
    if objs:
        geoms = [obj.Geometry for obj in objs]
        layerTree.append(geoms)

layerTree = th.list_to_tree(layerTree, source=[0,0])
a = layerTree
# ---------- end objsinlayers_th ----------
panel_4 = Panel(data)
bang = ExplodeTree(Data=data)  # -> Branch0, Branch1
python = GhPythonScript()  # -> out, a, b, path1, layerTree
# ---------- python: Python ----------
__author__ = "User"
__version__ = "2022.04.10"

from Grasshopper.Kernel.Data import GH_Path
from Grasshopper import DataTree
import rhinoscriptsyntax as rs
import System.Array as array

b=[0,0,1]
c=[0]
print type(b)
a=array[int]([0,0,1])
print type(a)
path1=GH_Path(a)

layerTree = DataTree[object]()
layerTree.AddRange(c,path1)
# ---------- end python ----------
panel_5 = Panel(objsinlayers.a)
panel_6 = Panel(objsinlayers_th.a)
explaintree = GhPythonScript(x=data)  # -> a; inputs x: tree
# ---------- explaintree: Python ----------
# (to access gh types - here not needed)
# from Grasshopper.Kernel.Data import GH_Path
# from Grasshopper import DataTree

a = []

for i in range(x.BranchCount):
    branchList = x.Branch(i)
    branchPath = x.Path(i)
    
    for j in range(branchList.Count):
        s = str(branchPath) + "[" + str(j) + "] "
        s += type(branchList[j]).__name__ + ": "
        s += str(branchList[j])
        
        a.append(s)
# ---------- end explaintree ----------
explaintree_th = GhPythonScript(x=data)  # -> a; inputs x: tree
# ---------- explaintree_th: Python ----------
import ghpythonlib.treehelpers as th

x = th.tree_to_list(x)

print x
a = []

for i,branch in enumerate(x):
    
    for j,item in enumerate(branch):
        s = str(i) + "[" + str(j) + "] "
        s += type(item).__name__ + ": "
        s += str(item)
        
        a.append(s)
# ---------- end explaintree_th ----------
panel_7 = Panel(python.a)
panel_8 = Panel(python.b)
panel_9 = Panel(python.path1)
panel_10 = Panel(python.layerTree)
panel_11 = Panel(explaintree)
panel_12 = Panel(explaintree_th)
